% Simulink data dictionary Definitions.sldd

bbbBus = Simulink.Bus()
  cc: Bus: ccBus
  dd: Bus: ddBus

ccBus = Simulink.Bus()
  f: double[2 2]
  g: double

bbBus = Simulink.Bus()
  d: uint32
  e: double

aaaBus = Simulink.Bus()
  c: int8
  bb: Bus: bbBus

MyEnum = enum(DefaultValue="A")
  A = 0
  B = 1

aaBus = Simulink.Bus()
  a: Enum: MyEnum
  b: int16

aaaaBus = Simulink.Bus()
  aa: Bus: aaBus
  aaa: Bus: aaaBus
  bbb: Bus: bbbBus
  j: Enum: MyEnum

ddBus = Simulink.Bus()
  h: boolean
  i: single